# Grasshopper definition p20_connect_control.ghx (Grasshopper 1.0.7)

# ----
# Pump Server
panel = Panel("C:\ProgramData\Anaconda3")
# Instructions:
# 
# 1. Start the Pump server
# 2. Ensure Pump is connected to R485 to USB converter and USB is connected to this PC
# 3. Connect the Pump Client (find correct COM port)
# 4. Control the pump using the Start/Stop and Speed settings (limited to -20 to 100)
panel_2 = Panel("mobileam")
# P20 Connect Controller
button = Button()
pump_controller = GhPythonScript(start=button, anaconda_path=panel, anaconda_env=panel_2)  # -> out, a
# ---------- pump_controller: Python ----------
import os
import subprocess
import shlex
import pump_control

pc = os.path.dirname(pump_control.__file__)
pump_server = str(os.path.join(pc, "p20_connect\pump_server.py"))
assert pump_server
print(pump_server)

def start_script():
    anaconda = r"{}\Scripts\activate.bat ".format(anaconda_path)
    env_activate = anaconda_path+"\envs\{}".format(anaconda_env)
    command_line = r""" cmd /c "{}&conda info&python {}" """.format(anaconda+env_activate, pump_server)
    print(command_line)
    args = shlex.split(command_line)
    response = subprocess.Popen(args)
   
if start:
    start_script()
# ---------- end pump_controller ----------

# ----
# Pump Client
speed = Slider(-20, range=-20..100)
button_2 = Button()
list = ValueList({"1", "2", "3", "4", "5", "6"}, selected="6")
python = GhPythonScript(COM=list, connect=Button(), start=Button(), stop=Button(), set_spd=Toggle(True), speed=speed)  # -> out, a; inputs COM: Int32, speed: Int32
# ---------- python: Python ----------
from scriptcontext import sticky as st
import imp
from compas_fab.ghpython.components import create_id
from pump_control import PumpClient
#pc = imp.load_source('module.name', path)

key = 'pumpclient'
if connect: 
    pumpclient = PumpClient()
    pumpclient.connect()
    pumpclient.connect_pump(COM)
    st[key] = pumpclient

pumpclient = st[key]
if start:
    pumpclient.start_pump()
if stop:
    pumpclient.stop_pump()
if set_spd:
    pumpclient.set_pump_speed(speed)
# ---------- end python ----------
rec = DataRecorder(python.out, DataLimit=-10, RecordData=True)
panel_3 = Panel(rec)
